# Grasshopper definition aux_unit_cell.gh (Grasshopper 1.0.7)

phi_dec = Slider(60, range=0..60)
L = Slider(10, range=0..10)
rad = Radians(Degrees=phi_dec)
num = Number(rad)
expression = Expression(L=L, phi=num, Expression="L*Sin(phi)/Sin(π/3)")
expression_2 = Expression(a=expression, L=L, phi=num, Expression="a+L*Sin(π/6-phi)")
expression_3 = Expression(L=L, phi=num, Expression="L*Cos(π/6-phi)")
expression_4 = Expression(a=expression, L=L, phi=num, Expression="a+L*Cos(phi)")
expression_5 = Expression(L=L, phi=num, Expression="L*Sin(phi)")
pt_3 = ConstructPoint(XCoordinate=expression_5, YCoordinate=expression_4, ZCoordinate=0)
pt1 = ConstructPoint(XCoordinate=0, YCoordinate=expression, ZCoordinate=0)
pt2 = ConstructPoint(XCoordinate=expression_3, YCoordinate=expression_2, ZCoordinate=0)
ln = Line(StartPoint=pt1, EndPoint=pt2)
ln_2 = Line(StartPoint=pt2, EndPoint=pt_3)
ln_3 = Line(StartPoint=pt1, EndPoint=pt_3)
relay = Relay([ln, ln_2, ln_3])
crv = Curve(relay)
join = JoinCurves(Curves=crv, Preserve=False)
expression_6 = Expression(a=expression, L=L, phi=num, Expression="2*(a*Cos(π/6)+L*Cos(π/6-phi))")
expression_7 = Expression(a=expression, L=L, phi=num, Expression="a*(Sin(π/6)+1)+L*Cos(phi)")
yz = YZPlane(Origin=Point(0, 0, 0))
srf = Surface(join)
mirror = Mirror(Geometry=srf, Plane=yz)  # -> Geometry, Transform
srf_2 = Surface([join, mirror.Geometry])
xy = XYPlane(Origin=Point(0, 0, 0))
_3 = Number(3)
arrpolar = PolarArray(Geometry=srf_2, Plane=xy, Count=_3, Angle=6.283185307)  # -> Geometry, Transform
pt = ConstructPoint(XCoordinate=expression_6, YCoordinate=expression_7, ZCoordinate=0)
box = Box2Pt(PointA=Point(0, 0, 0), PointB=pt, Plane=PlaneXY(0, 0, 0))
srf_3 = Surface([srf_2, arrpolar.Geometry])
arrbox = BoxArray(Geometry=srf_3, Cell=box, XCount=Slider(5, range=0..10), YCount=Slider(3, range=0..10), ZCount=2)  # -> Geometry, Transform
srf_4 = Surface(arrbox.Geometry)

L_2 = Slider(10, range=0..10)
pi = Pi(Factor=Slider(0, range=0..0.3333))
number_slider = Slider(3, range=0..10)
number_slider_2 = Slider(3, range=0..10)
beyondtrigen = GhPythonScript(l=L_2, phi=pi)  # -> tri
# ---------- beyondtrigen: Python ----------
"""
Generates a periodic triangular pattern based on the beyond developables paper

    Args:
        l: Edge length of the triangle
        phi: Degree of opening of the triangular grid
    Returns:
        tri: Polyline of a triangle within the auxetic hexagon
"""
import rhinoscriptsyntax as rs
from math import tan, sin, cos, pi, sqrt
pList = []
x0 = 0
y0 = l*sin(phi)/sin(pi/3)

x1 = l*cos(pi/6-phi)
y1 = y0+l*sin(pi/6-phi)

x2 = l*sin(phi)
y2 = y0+l*cos(phi)

pList.append([x0,y0,0])
pList.append([x1,y1,0])
pList.append([x2,y2,0])
pList.append([x0,y0,0])

rsP = [rs.AddPoint(x) for x in pList]
tri = rs.AddPolyline(rsP)
# ---------- end beyondtrigen ----------
rapidtrigen = GhPythonScript(l=L_2, xf=Slider(2, range=1..2))  # -> tri
# ---------- rapidtrigen: Python ----------
"""
Generates a periodic triangular pattern based on the rapid deployment paper

    Args:
        l: Edge length of the triangle
        xf: Required expansion factor
    Returns:
        tri: Polyline of a triangle within the auxetic hexagon
"""
import Rhino.Geometry as rg
import re
from math import sqrt, pi, tan,cos,sin,degrees, atan, atan2
import rhinoscriptsyntax as rs
from collections import Counter

import os
import csv

import ghpythonlib.treehelpers as th
import copy

import rhinoscriptsyntax as rs

def auxPhi (xf):
    if xf >= 2:
        phi = 0
    elif xf <= 1:
        phi = pi/3
    else:
        phi = atan2(sqrt(3*xf - 3*sqrt(-xf**4 + 4*xf**3 - 3*xf**2))/2 , -sqrt(3*xf - 3*sqrt(-xf**4 + 4*xf**3 - 3*xf**2))*(xf**2 + 2*sqrt(-xf**4 + 4*xf**3 - 3*xf**2))*sqrt(3)/(6*xf*(xf - 2)))
    return phi
 
 
def norm(a):
    return sqrt(sum([a[i]**2 for i in [0,1,2]]))
     
def vecMult(v,a):
    return [vi*a for vi in v]
    
def ppClosest(h, n):
    '''
    Find the point in h that n is closest to
    '''
    tempD = [rs.Distance(hi,n) for hi in h]
    if min(tempD)>2:
        errorTog = True
    else:
        errorTog = False
    return tempD.index(min(tempD)), errorTog


def mP(p0,p1):
    '''
    Find mid point of two points
    '''
    return rs.AddPoint([(p0[i]+p1[i])/2 for i in [0,1,2]])
    
phi = auxPhi(xf)
conLineT = []

# generate a triangle given the phi value. The phi value is determined by the scale factor
x0 = 0
y0 = sin(phi)/sin(pi/3)

x1 = cos(pi/6-phi)
y1 = y0+sin(pi/6-phi)

x2 = sin(phi)
y2 = y0+cos(phi)

ptL = []
ptL.append([x0, y0,0])
ptL.append([x1, y1,0])
ptL.append([x2, y2,0])
ptL.append([x0, y0,0])
rsPtL = rs.AddPoints(ptL)

theta = (atan(ptL[2][0]/ ptL[2][1]))

# rescale the triangle to fit the boundary of the grid trig
sizing_factor = (sqrt(3)/((tan(theta) + sqrt(3))*cos(theta)))/norm(ptL[2])

# and also scale by the l_o
rs.ScaleObjects(rsPtL,[0,0,0],[l*sizing_factor]*3)

rsPtL.append(rsPtL[0])

tri  = rs.AddPolyline(rsPtL)
# ---------- end rapidtrigen ----------
swatch = ColourSwatch(SwatchColor=RGB(50, 94, 227))
trideployment = GhPythonScript(l=L_2, phi=pi, tri=beyondtrigen, xC=number_slider, yC=number_slider_2)  # -> rsPLT; inputs xC: Int32, yC: Int32
# ---------- trideployment: Python ----------
"""
Generates a periodic triangular pattern based on the beyond deployables paper

    Args:
        l: Edge length of the triangle
        phi: Opening angle
        tri: Single triangle polyline
        xC: Tiling in x direction
        yC: Tiling in y direction
    Returns:
        rsPLT: Polyline of the entire grid
"""
import rhinoscriptsyntax as rs
from math import tan, sin, cos, pi, sqrt

rsPLP = []
rsPLU = []

y0 = l*sin(phi)/sin(pi/3)

rsPL = tri
rsPLP.append(rs.CopyObject(rsPL))
rsPLP.append(rs.MirrorObject(rs.CopyObject(rsPL), [0,0,0],[0,1,0]))

rsPLU.append(rsPLP)

temp = rs.CopyObjects(rsPLP)

rsPLU.append(rs.RotateObjects(temp, [0,0,0],120))

temp = rs.CopyObjects(rsPLP)

rsPLU.append(rs.RotateObjects(temp, [0,0,0],240))

rsPLU = [item for sublist in rsPLU for item in sublist]

rsPLT = []
vec = [2*(y0*cos(pi/6)+l*cos(pi/6-phi)), y0*(sin(pi/6)+1)+l*cos(phi),0]

for i in range(xC):
    for j in range(yC):
        rsPLT.append([rs.CopyObject(x,[vec[0]*i,vec[1]*j,0]) for x in rsPLU])
        
rsPLT = [item for sublist in rsPLT for item in sublist]
# ---------- end trideployment ----------
trideployment_2 = GhPythonScript(l=L_2, tri=rapidtrigen, xC=number_slider, yC=number_slider_2)  # -> rsPLT; inputs xC: Int32, yC: Int32
# ---------- trideployment_2: Python ----------
"""
Generates a periodic triangular pattern based on the rapid deployment paper

    Args:
        l: Edge length of the triangle
        tri: Single triangle polyline
        xC: Tiling in x direction
        yC: Tiling in y direction
    Returns:
        rsPLT: Polyline of the entire grid
"""
import rhinoscriptsyntax as rs
from math import tan, sin, cos, pi, sqrt
phi = 0
rsPLP = []
rsPLU = []

y0 = l*sin(phi)/sin(pi/3)

rsPL = tri
rsPLP.append(rs.CopyObject(rsPL))
rsPLP.append(rs.MirrorObject(rs.CopyObject(rsPL), [0,0,0],[0,1,0]))

rsPLU.append(rsPLP)

temp = rs.CopyObjects(rsPLP)

rsPLU.append(rs.RotateObjects(temp, [0,0,0],120))

temp = rs.CopyObjects(rsPLP)

rsPLU.append(rs.RotateObjects(temp, [0,0,0],240))

rsPLU = [item for sublist in rsPLU for item in sublist]

rsPLT = []
vec = [2*(y0*cos(pi/6)+l*cos(pi/6-phi)), y0*(sin(pi/6)+1)+l*cos(phi),0]

for i in range(xC):
    for j in range(yC):
        rsPLT.append([rs.CopyObject(x,[vec[0]*i,vec[1]*j,0]) for x in rsPLU])
        
rsPLT = [item for sublist in rsPLT for item in sublist]
# ---------- end trideployment_2 ----------
material = CreateMaterial(Diffuse=swatch, Specular=swatch, Emission=RGB(0, 0, 0), Transparency=0, Shine=0)
srf_5 = Surface(trideployment)
srf_6 = Surface(trideployment_2)
preview = CustomPreview(Geometry=srf_5, Material=material)
preview_2 = CustomPreview(Geometry=srf_6, Material=material)
