# Grasshopper definition bass_unit_cell.gh (Grasshopper 1.0.7)

pi = Pi(Factor=Slider(0, range=-0.166..0.166))
norm = GhPythonScript(theta=pi, phi=Slider(0, range=0..1))  # -> phi_o
# ---------- norm: Python ----------
"""
Remap the feasible phi range based on theta
    Args:
        theta: Parameter theta
        phi: Opening angle (between 0 and 1)
    Returns:
        phi_o: actual phi angle

"""

import rhinoscriptsyntax as rs
from math import pi

ang = theta*2+pi/3.

phi_o = phi*ang
# ---------- end norm ----------
triangle = GhPythonScript(
    l=Slider(10, range=0..20),
    s=Slider(0.25, range=0..1),
    c=Slider(0.25, range=0..1),
    t=Slider(1.8, range=0..3),
    theta=pi,
    phi=norm)  # -> U, hexR
# ---------- triangle: Python ----------
"""
Generate a periodic bistable auxetic unit cell geometry, 
refer to Bistable Auxetic Surface Structures

    Args:
        l: Edge length of the triangle
        s: Width of the cut lines
        c: Width of the hinge
        t: Parameter t
        theta: Parameter theta
        phi: Opening angle
    Returns:
        U: Unit cell geometry
        hexR: Radius of the hexagon that enclose the cell

"""
import rhinoscriptsyntax as rs
from math import sqrt,cos,sin,tan,pi, degrees
def rsDot(v1,v2):
    return v1.X*v2.X+v1.Y*v2.Y+v1.Z*v2.Z
def dot(v1,v2):
    return v1[0]*v2[0]+v1[1]*v2[1]+v1[2]*v2[2]
    
theta = degrees(theta)
phi = degrees(phi)
def RayRayIntersection(c1,c2):
    t = rs.CurveCurveIntersection(c1,c2)
    if t == None:
        bigNum = 100
        rs.ScaleObject(c1, rs.CurveMidPoint(c1),[bigNum]*3)
        rs.ScaleObject(c2, rs.CurveMidPoint(c2),[bigNum]*3)
    
    t = rs.CurveCurveIntersection(c1,c2)[0][1]
    
    return t
corner_left  = rs.CreatePoint([0,0,0])
corner_right = rs.CreatePoint([l,0,0])

ccw = 60

line_horiz = rs.AddLine(corner_left,corner_right)
line_left  = rs.RotateObject(line_horiz, corner_left,ccw, copy=True)
line_right = rs.RotateObject(line_horiz, corner_right,-ccw, copy=True)

corner_top = rs.CurveCurveIntersection(line_left,line_right)[0][1]

vec_left_up     = rs.VectorUnitize(rs.VectorCreate(corner_top, corner_left))
vec_bottom_left = rs.VectorUnitize(rs.VectorCreate(corner_left, corner_right))
vec_right_down  = rs.VectorUnitize(rs.VectorCreate(corner_right, corner_top))

pt1  = rs.CopyObject(corner_left,  vec_left_up     * t)
pt1s = rs.CopyObject(corner_left,  vec_left_up     * (t+s))
pt2  = rs.CopyObject(corner_right, vec_bottom_left * t)
pt2s = rs.CopyObject(corner_right, vec_bottom_left *(t+s))
pt3  = rs.CopyObject(corner_top,   vec_right_down  * t)
pt3s = rs.CopyObject(corner_top,   vec_right_down  * (t+s))

cut_lower  = rs.MoveObject(rs.RotateObject(line_horiz, corner_left, theta, copy=True), vec_left_up*t)
cut_lower2 = rs.MoveObject(rs.RotateObject(line_horiz, corner_left, theta, copy=True), vec_left_up*(t+s))
cut_right  = rs.MoveObject(rs.RotateObject(line_right, corner_right, theta, copy=True), vec_bottom_left*t)
cut_right2 = rs.MoveObject(rs.RotateObject(line_right, corner_right, theta, copy=True), vec_bottom_left*(t+s))
cut_top    = rs.MoveObject(rs.RotateObject(line_left, corner_top, theta, copy=True), vec_right_down*t)
cut_top2   = rs.MoveObject(rs.RotateObject(line_left, corner_top, theta, copy=True), vec_right_down*(t+s))

tri_lr = rs.CurveCurveIntersection(cut_lower2, cut_right2)[0][1]
tri_ll = rs.CurveCurveIntersection(cut_lower2, cut_top2)[0][1]
tri_t  = rs.CurveCurveIntersection(cut_top2, cut_right2)[0][1]

# <--
vec_tri_bl = rs.VectorUnitize(rs.VectorCreate(tri_ll, tri_lr))
# /^
vec_tri_lu = rs.VectorUnitize(rs.VectorCreate(tri_t, tri_ll))
# \v
vec_tri_rd = rs.VectorUnitize(rs.VectorCreate(tri_lr, tri_t))

tri_lri = rs.CopyObject(tri_lr, vec_tri_bl * c)
tri_lli = rs.CopyObject(tri_ll, vec_tri_lu * c)
tri_ti  = rs.CopyObject(tri_t,  vec_tri_rd * c)

pt1i_   = rs.CurveCurveIntersection(cut_lower, cut_right2)[0][1]
pt1i__  = rs.CurveCurveIntersection(cut_lower, cut_right)[0][1] # used for the boundary adaption
temp    = rs.VectorUnitize(rs.VectorCreate(pt1i_, pt1))
pt1i    = rs.CopyObject(pt1i_, -temp*c)

pt2i_   = rs.CurveCurveIntersection(cut_right,cut_top2)[0][1]
pt2i__  = rs.CurveCurveIntersection(cut_right,cut_top)[0][1]
temp    = rs.VectorUnitize(rs.VectorCreate(pt2i_, pt2))
pt2i    = rs.CopyObject(pt2i_, -temp*c)
#pt2i    = pt2i_ - ((pt2i_ - pt2) / (pt2i_ - pt2).norm()) * c

pt3i_   = rs.CurveCurveIntersection(cut_top,cut_lower2)[0][1]
pt3i__  = rs.CurveCurveIntersection(cut_top,cut_lower)[0][1]
temp    = rs.VectorUnitize(rs.VectorCreate(pt3i_, pt3))
pt3i    = rs.CopyObject(pt3i_, -temp*c)

flank_lower_l = [corner_left, pt1, pt3i__, pt1i, tri_lri, tri_lr, pt1i_, pt2s,corner_left]
flank_right_l = [corner_right, pt2, pt1i__, pt2i, tri_ti, tri_t, pt2i_, pt3s,corner_right]
flank_top_l   = [corner_top, pt3, pt2i__, pt3i, tri_lli, tri_ll, pt3i_, pt1s,corner_top]
triangle_l    = [tri_lli, tri_ll, tri_lri, tri_lr, tri_ti, tri_t,tri_lli]


# move the flanks to the tips of the inner triangle
tri_center = rs.CurveAreaCentroid(rs.AddPolyline(triangle_l))[0]
triangle_l = rs.RotateObjects(triangle_l, tri_center, -phi, copy=True)

flank_lower_l = rs.CopyObjects(flank_lower_l, rs.VectorCreate(triangle_l[3],flank_lower_l[5]))
flank_right_l = rs.CopyObjects(flank_right_l, rs.VectorCreate(triangle_l[5],flank_right_l[5]))
flank_top_l   = rs.CopyObjects(flank_top_l,   rs.VectorCreate(triangle_l[1],flank_top_l[5]))

# inset a triangle from which to extrude the hinges
tri_side_len      = rs.VectorLength(rs.VectorCreate(triangle_l[1], triangle_l[3]))
tri_height        = tri_side_len * sqrt(3)/2
target_tri_height = tri_height - (1 + 2) * c

tri_inset_fac = target_tri_height / tri_height
inset_tri_l   = rs.ScaleObjects(triangle_l, tri_center, [tri_inset_fac]*3, copy=True)

#---------

    # the lines limiting the inner, inset triangle
inset_tri_line_bottom = rs.AddLine(inset_tri_l[1], inset_tri_l[3])
inset_tri_line_left   = rs.AddLine(inset_tri_l[1], inset_tri_l[5])
inset_tri_line_right  = rs.AddLine(inset_tri_l[5], inset_tri_l[3])

# lines limiting the usual inner triangle
tri_line_bottom = rs.AddLine(triangle_l[1], triangle_l[3])
tri_line_left   = rs.AddLine(triangle_l[1], triangle_l[5])
tri_line_right  = rs.AddLine(triangle_l[5], triangle_l[3])

# the lines on top of the flanks, parallel to the inner triangle lines
flank_lower_linetop = rs.AddLine(flank_lower_l[2], flank_lower_l[3])
flank_right_linetop = rs.AddLine(flank_right_l[2], flank_right_l[3])
flank_top_linetop   = rs.AddLine(flank_top_l[2], flank_top_l[3])
b=flank_lower_linetop
# adapt the hinges
flank_lower_intersect = RayRayIntersection(flank_lower_linetop, inset_tri_line_right)
flank_lower_l[3] = flank_lower_intersect
tri_intersect    = RayRayIntersection(tri_line_bottom, inset_tri_line_right)
triangle_l[2]    = tri_intersect
flank_lower_l[4] = tri_intersect

flank_right_intersect = RayRayIntersection(flank_right_linetop, inset_tri_line_left)
flank_right_l[3] = flank_right_intersect
tri_intersect    = RayRayIntersection(tri_line_right,inset_tri_line_left)
triangle_l[4]    = tri_intersect
flank_right_l[4] = tri_intersect

flank_top_intersect = RayRayIntersection(flank_top_linetop,inset_tri_line_bottom)
flank_top_l[3] = flank_top_intersect
tri_intersect  = RayRayIntersection(tri_line_left,inset_tri_line_bottom)
triangle_l[0]  = tri_intersect
flank_top_l[4] = tri_intersect

# Move the triangle so it sits on 0,0 bottom left
bl_corner = rs.CreateVector(flank_lower_l[0])

flank_lower_l = rs.CopyObjects(flank_lower_l, -bl_corner)
flank_right_l = rs.CopyObjects(flank_right_l, -bl_corner)
flank_top_l   = rs.CopyObjects(flank_top_l,   -bl_corner)
triangle_l    = rs.CopyObjects(triangle_l,    -bl_corner)

#line_left  = rs.AddLine(flank_top_l[0], flank_top_l[-1])
#line_right = rs.AddLine(flank_right_l[0], flank_right_l[-1])
#line_horiz = rs.AddLine(flank_lower_l[0], flank_lower_l[-1])
#corner_top = RayRayIntersection(line_left,line_right)

flank_lower = rs.AddPolyline(flank_lower_l)
flank_right = rs.AddPolyline(flank_right_l)
flank_top   = rs.AddPolyline(flank_top_l)
triangle    = rs.AddPolyline([triangle_l[tri_pt] for tri_pt in [1,5,3,1]])

[x0,y0,z0]=rs.PointCoordinates(flank_right_l[-1])
[x1,y1,z1]=rs.PointCoordinates(flank_right_l[-2])

m=(y1-y0)/(x1-x0)
b= y0-m*x0

Ori = rs.AddPoint([-b/m,0,0])

[x1,y1,z1]=rs.PointCoordinates(flank_top_l[0])
[x2,y2,z2]=rs.PointCoordinates(flank_top_l[-2])

x0=-b/m

y0=0
inscR = abs((y1-y2)*x0+(x2-x1)*y0+x1*y2-x2*y1)/sqrt((x2-x1)**2+(y2-y1)**2)
hexR  = inscR/cos(pi/6)

rs.MoveObject(flank_lower,[b/m,0,0])
rs.MoveObject(flank_right,[b/m,0,0])
rs.MoveObject(flank_top,[b/m,0,0])
rs.MoveObject(triangle,[b/m,0,0])

U = [flank_lower, flank_right, flank_top, triangle]
# ---------- end triangle ----------
srf = Surface(triangle.U)
mirror = Mirror(Geometry=srf, Plane=Plane(origin=(0, 0, 0), x=(-0.5, 0.8660254038, 0), y=(0, 0, 1)))  # -> Geometry, Transform
flip = Flip(Surface=mirror.Geometry)  # -> Surface, Result
pt = Point(Point(0, 0, 0))
hexgrid = Hexagonal(Plane=pt, Size=triangle.hexR, ExtentX=Slider(4, range=0..10), ExtentY=Slider(3, range=0..10))  # -> Cells, Points
srf_2 = Surface([flip.Surface, srf])
arrpolar = PolarArray(Geometry=srf_2, Plane=PlaneXY(0, 0, 0), Count=3, Angle=6.283185307)  # -> Geometry, Transform
vec2pt = Vector2Pt(PointA=pt, PointB=hexgrid.Points, Unitize=False)  # -> Vector, Length
move = Move(Geometry=flatten(arrpolar.Geometry), Motion=graft(vec2pt.Vector))  # -> Geometry, Transform
srf_3 = Surface(simplify(move.Geometry))
material = CreateMaterial(
    Diffuse=ColourSwatch(SwatchColor=RGB(168, 196, 255)),
    Specular=ColourSwatch(SwatchColor=RGB(5, 26, 38)),
    Emission=ColourSwatch(SwatchColor=RGB(31, 31, 31)),
    Transparency=0,
    Shine=0)
preview = CustomPreview(Geometry=srf_3, Material=material)
