# Grasshopper definition generation_aux_bass.gh (Grasshopper 1.0.7)

python = GhPythonScript()  # -> modelPath, DBPath
# ---------- python: Python ----------
import platform
fFile = ghdoc.Path

if platform.system() == "Windows":
    fPath = fFile.rsplit('\\',1)
else:    
    fPath = fFile.rsplit('/',1)
    
modelPath = fPath[0]+'\input_models'

DBPath = fPath[0]+'\bass_unit_cell_results.csv'
# ---------- end python ----------
list = ValueList({"double_dome", "hemisphere", "hypar", "lilium_tower", "quarter_dome", "tigridia", "vase", "squidward"}, selected="hemisphere")
number_slider = Slider(5, range=0..10)
list_2 = ValueList({"bass", "auxetics": "aux"}, selected="auxetics")
list_3 = ValueList({"stiffness", "energy"}, selected="stiffness")
vec = VectorXYZ(XComponent=Slider(0, range=-2..5), YComponent=Slider(0, range=-2..2), ZComponent=0)  # -> Vector, Length
scale_factor_calculation = PythonScript(
    modelPath=python.modelPath,
    modelName=list,
    geomType=list_2,
    in_l_o=number_slider,
    DBpath=python.DBPath,
    selectMode=list_3,
    grid_offset=vec.Vector)  # -> msg, uv_mesh, uv_mesh_edge, t_mesh, centroids_uv, param_out, v_out, f_out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
# ---------- scale_factor_calculation: Python ----------
import Rhino.Geometry as rg
import re
from math import sqrt, pi, tan,cos,sin,degrees, atan2, atan
import rhinoscriptsyntax as rs
from collections import Counter

import os
import csv

import ghpythonlib.treehelpers as th
import copy

REX_VT = re.compile(r"vt\s+(-?\d+\.\d+)\s+(-?\d+\.\d+)")
REX_FACE = re.compile(r"f\s+(\d+)\/(\d+)\s+.*?(\d+)\/(\d+)\s+.*?(\d+)\/(\d+).*?")

def vecCross(a, b):
    if len(a)==3:
        c = [a[1]*b[2] - a[2]*b[1],
             a[2]*b[0] - a[0]*b[2],
             a[0]*b[1] - a[1]*b[0]]
    elif len(a)==2:
        c = [0, 0, a[0]*b[1] - a[1]*b[0]]
    return c

def norm(a):
    return sqrt(sum([a[i]**2 for i in [0,1,2]]))
     
def vecSub(a,b): # a - b
    if len(a)==3:
        return [a[i]-b[i] for i in [0,1,2]]
    elif len(a)==2:
        return [a[i]-b[i] for i in [0,1]]
            
def triangle_areas(v, f):
    areas = []
    for i,j,k in f:
        area2 = norm(vecCross(vecSub(v[i], v[j]), vecSub(v[i], v[k])))
        areas.append(area2/2.)
    return areas

def get_floppy_triangles(f_grid):
    '''
    filter the triangles that has at least one vertex that is not connected to any other triangles
    '''
    f_grid_flat = [item for sublist in f_grid for item in sublist]
    
    res= Counter (f_grid_flat)
    
    idE = []
    
    for key, item in res.items():  # for name, age in dictionary.iteritems():  (for Python 2.x)
        if item == 1:
            idE.append(key)
            
    return idE

def removeId(f_grid, idE):
    '''
    Remove the floppy triangles by replacing them with [-1] so that the numbering doesn't change
    '''
    temp = []
    id_y = []
    id_n = []
    for i,fi in enumerate(f_grid):
        if fi != [-1]: # if it is not already filtered out
            if fi[0] not in idE and fi[1] not in idE and fi[2] not in idE: #check if any of each face has a floppy vertex
                temp.append(fi)
                id_y.append(i)
            else: # if there is one, then change the face to [-1]
                temp.append([-1])
                id_n.append(i)
        else:
            temp.append([-1])
    return id_y,id_n, temp

def normList(l):
    return [li/sum(l) for li in l]
    
def distClosest(needle, hay, d):
    '''
    return all the indices in the list that is close to a value by distance d (1-D)
    '''
    bL = [abs(x-needle)<d for x in hay]
    return [i for i, x in enumerate(bL) if x]
    
def ppClosest(h, n):
    '''
    Find the point in h that n is closest to
    '''
    tempD = [rs.Distance(hi,n) for hi in h]
    if min(tempD)>1:
        errorTog = True
    else:
        errorTog = False
    return tempD.index(min(tempD)), errorTog

def noneList(x,a):
    ''' change the indices a of x to [-1] '''
    for ai in a:
        x[ai] = [-1]
        
def noneListR(a):
    ''' remove [-1] '''
    idxD = dict()
    idx = 0
    temp = []
    for i, ai in enumerate(a):
        if ai != [-1]:
            temp.append(ai)
            idxD[i]=idx
            idx+=1
            
    return temp, idxD
        
    
def argmax(l):
    return l.index(max(l))
    
def argmin(l):
    return l.index(min(l))
    
def remove_unused_verts(v, f):
    """
    Takes a mesh in form of verts and triangles and
    returns a new mesh with the verts removed that are not
    referenced in the triangles.
    """
    
    v_new = []
    f_new = []
    c_new = []
    
    for fi in f:
        (i0, i1, i2) = fi
        
        # Round is cheap method to check do "is approximately in"
        v1 = [round(x,8) for x in v[i0]]
        v2 = [round(x,8) for x in v[i1]]
        v3 = [round(x,8) for x in v[i2]]
        
        # if v1,2,3 is not in v_new then it is a new point that should be appended
        if v1 not in v_new:
            v_new.append(v1)
        if v2 not in v_new:
            v_new.append(v2)
        if v3 not in v_new:
            v_new.append(v3)
        
        # faces then append the id of all three points, 
        # now that they have to be in v_new
        f_new.append([v_new.index(v1), v_new.index(v2), v_new.index(v3)])
        
    return v_new, f_new

def load_obj(obj_path):
    file = open(obj_path)
    lines = file.readlines()

    f = []
    v = []
    uv = []
    
    t_mesh  = rg.Mesh()  # Target mesh
    uv_mesh = rg.Mesh()  # UV (flat) mesh
    
    f_lines  = [line for line in lines if line.startswith("f")]
    v_lines  = [line for line in lines if (line.startswith("v") and line.find("n")==-1 and line.find("t")==-1)]
    uv_lines = [line for line in lines if line.startswith("vt")]
    
    for line in v_lines:
        v.append([float((line.split(' '))[1]),float((line.split(' '))[2]),float((line.split(' '))[3])])
        t_mesh.Vertices.Add(rg.Point3d(*v[-1]))
    
    uvs = [[float(coord) for coord in REX_VT.findall(line)[0]] for line in uv_lines]
    uv_indices = [None] * len(uvs)
    
    for line in f_lines:
            f.append([int(line.split(' ')[1].split('/')[0])-1,int(line.split(' ')[2].split('/')[0])-1,int(line.split(' ')[3].split('/')[0])-1])
            
            mf = rg.MeshFace(*f[-1])
            
            uv_mesh.Faces.AddFace(mf) # the two meshes have the same connectivities
            t_mesh.Faces.AddFace(mf)  # the two meshes have the same connectivities
            
            res_str = REX_FACE.findall(line)[0]
            res_int = [int(index) - 1 for index in res_str]

            v1, uv1, v2, uv2, v3, uv3 = res_int

            try:
                uv_indices[v1] = uv1
                uv_indices[v2] = uv2
                uv_indices[v3] = uv3
            except Exception as e:
                print("uv1", uv1, "uv2", uv2, "uv3", uv3)
                print(len(uvs))
                raise e

    uvs_sorted = [uvs[i] for i in uv_indices]
    
    [uv_mesh.Vertices.Add(rg.Point3d(uvs[0],uvs[1],0)) for uvs in uvs_sorted]
    uv_mesh.Compact()
    t_mesh.Normals.ComputeNormals()
    t_mesh.Compact()
    
    return [v,f,uvs_sorted,uv_mesh,t_mesh]

def load_mesh_and_scale_facs(parametrized_obj_path, verbose):
    [v,f,uvs,uv_mesh,t_mesh]=load_obj(parametrized_obj_path)

    tri_areas3d = triangle_areas(v, f)
    tri_areas2d = triangle_areas(uvs, f)

    scale_facs = [x/y for x,y in zip(tri_areas3d, tri_areas2d)]

    zero_area_2dtris = [tri_areas2d < 1e-8 for x in tri_areas2d]

    for i,x in enumerate(zero_area_2dtris):
        if x == True:
            scale_facs[i] = None

    if sum(zero_area_2dtris) > 0:
        warnings.warn(
            "Something is wrong with your UV-map. Some triangles have near-zero or zero area."
            "This leads to infinite scale factors."
        )

    if verbose:
        print("Scale facs min: "+str(min(scale_facs)) +", max: "+str(max(scale_facs)))

    return v, f, uvs, scale_facs, uv_mesh, t_mesh

def flip(i):
    if i==0:
        return 1
    elif i==1:
        return 0

# in even last one, i dont exclude the upper triangle, which causes issues
def generate_regular_tri_grid(rows, cols, l=1, ox=0, oy=0):
    v = []
    f = []
    c = []
    i_grid = []
    x_grid = []
    
    h = sqrt(3)/2*l # Height of the triangle
    
    idE = 0 # Counter for elements
    for row in range(rows):
        for col in range(cols):
            if row%2==0:
                v.append([l*col+ox,h*row+oy, 0])
            else:
                v.append([l*col+l/2+ox,h*row+oy, 0])
                
    for row in range(rows-1):
        iList = []
        for col in range(cols-1):
            
            if row%2==0:
                m = 1
                n = 0
                iList.append(0)
                iList.append(1)
                
            else:
                m = 0
                n = 1
                iList.append(1)
                iList.append(0)
        
            n0 = col + row*cols
            n1 = col + row*cols + 1
            n2 = col + (row+1)*cols + n
            # iso triangle #1
            fL1 = [n0,n1,n2]
        
            c0 = (v[n0][0]+v[n1][0])/2
            c1 = v[n0][1] + sqrt(3)/6*l
            # center of tri #1
            cL1 = [c0,c1,0]
            
            n0 = col + row*cols + m
            n1 = col + (row+1)*cols + 1
            n2 = col + (row+1)*cols
            
            # iso triangle #2
            fL2 = [n0,n1,n2]
            
            c0 = (v[n1][0]+v[n2][0])/2
            c1 = v[n1][1] - sqrt(3)/6*l
            
            # center of tri #2
            cL2 = [c0,c1,0]

            # this generation always starts with an a triangle with bottom edge aligned with the xaxis first
            if row%2==0:
                    
                f.append(fL1)
                c.append(cL1)
                f.append(fL2)
                c.append(cL2)
                
                # Find the ID of the neighbouring elements
                if row == 0:
                    if col == 0:
                        x_grid.append([idE+1])
                    else:
                        x_grid.append([idE-1, idE+1])
                else:
                    if col ==0:
                        x_grid.append([idE+1, idE-(cols-1)*2])
                    else:
                        x_grid.append([idE-1, idE-(cols-1)*2, idE+1])
                     
                idE+=1   
                
                # Find the ID of the neighbouring elements
                if row == rows-2:
                    if col == cols-2:
                        x_grid.append([idE-1])
                    else:
                        x_grid.append([idE-1, idE+1])
                else:
                    if col == cols-2:
                        x_grid.append([idE-1, idE+(cols-1)*2])
                    else:
                        x_grid.append([idE-1, idE+(cols-1)*2, idE+1])
                        
                idE+=1
                
            else:
                f.append(fL2)
                c.append(cL2)
                
                f.append(fL1)
                c.append(cL1)
                
                # Find the ID of the neighbouring elements
                if row == rows - 2:
                    if col ==0:
                        x_grid.append([idE+1])
                    else:
                        x_grid.append([idE-1, idE+1])

                else:
                    if col ==0:
                        x_grid.append([idE+1, idE+(cols-1)*2])
                    else:
                        x_grid.append([idE-1, idE+(cols-1)*2, idE+1])
                    
                idE+=1
                
                # Find the ID of the neighbouring elements
                if row == 0:
                    # But this wont happen unless we flip the order or even and odd
                    if col == cols - 2:
                        x_grid.append([idE-1])
                    else:
                        x_grid.append([idE-1, idE+1])
                else:
                    if col == cols-2:
                        x_grid.append([idE-1, idE-(cols-1)*2])
                    else:
                        x_grid.append([idE-1, idE-(cols-1)*2, idE+1])
                        
                idE+=1
                
        i_grid.append(iList)
        
    i_grid = [item for sublist in i_grid for item in sublist]
    
    return v,f,c,i_grid, x_grid

def generate_overlay_grid(rsv2d, params):
    """
    Takes a flattened mesh and returns the verts, faces
    for a triangular grid that envelops the input mesh.
    """
    boundv2d = rs.PointArrayBoundingBox(rsv2d)

    cols = int(round((boundv2d[2][0] - boundv2d[0][0])/in_l_o,0)+4)
    rows = int(round((boundv2d[2][1] - boundv2d[0][1])/(sqrt(3)/2*in_l_o),0)+4)

    ox  = boundv2d[0][0] - in_l_o * 2 + params['grid_offset'][0]
    oy  = boundv2d[0][1] - sqrt(3)/2 * in_l_o * 2 + params['grid_offset'][1]
 
    if rows + cols < 5:
        warnings.warn("The design is very small. Check your model size and units (mm assumed).")

    v_grid, f_grid, c_grid, i_grid, x_grid = generate_regular_tri_grid(rows, cols, in_l_o, ox, oy)
    
    return v_grid, f_grid, c_grid, i_grid, x_grid

def readData(fName):
    # All this stuff is only done once, at the time of module loading

    with open (fName) as csvfile:
        temp = csv.reader(csvfile, delimiter=',')
        rows = []
        for row in temp:
            rows.append(row)
            
    ts          = [float(x) for x in rows[0]]
    thetas      = [float(x) for x in rows[1]]
    expansions  = [float(x) for x in rows[2]]
    energies    = [float(x) for x in rows[3]]
    stiffnesses = [float(x) for x in rows[4]]
    
    # output the min and max of the parameter space
    print('ts_norm (t/l) min = ' + str(min(ts))     + ', max = ' + str(max(ts)))
    print('thetas  (rad) min = ' + str(min(thetas)) + ', max = ' + str(max(thetas)))
   
    return [ts, thetas, expansions, energies, stiffnesses]

def get_most_stable_for_expansion(target_expansion, data, tol_expansion=0.005, mode='stiffness', verbose=False, debug=False):

    ts          = data[0]
    thetas      = data[1]
    expansions  = data[2]
    energies    = data[3]
    stiffnesses = data[4]
    
    # Get the id of neighbours for each target exp within the tol
    exp_neigh   = [distClosest(x, expansions, tol_expansion) for x in target_expansion]
    
    id_selected = []
    select_neigh = []
    for ids in exp_neigh:
        # If none then not bistable
        if not ids:
            select_neigh.append(None)
            return
        if mode =='energy':
            # get barrier height of these close neighbours
            barrier_neigh = [energies[idi] for idi in ids]
            select_neigh  = barrier_neigh
            
        elif mode =='stiffness':
            # get barrier height of these close neighbours
            stiff_neigh   = [stiffnesses[idi] for idi in ids]
            select_neigh  = stiff_neigh
        
        id_selected.append(ids[argmax(select_neigh)])
        
    return id_selected
    
def interp_and_rescale(v_grid, f_grid, c_grid, x_grid, uv_mesh, i_grid, scale_facs, scale_min, scale_max, geomType, dbName, mode='energy',verbose=True):
    """
    Takes a regular triangular grid and a flattened triangular mesh
    and interpolates the scale factors from the mesh to the regular grid.

    for_expanded_cells: Shift the scale factors such that we get parameters for opened cells that close
                        instead of closed ones that open 

    use_bb: Use the bounding box of the uv map instead of the uv map itself to fit the tri grid into.
            Useful for cylinders, i.e. if you need the top and bottom of the pattern to be gluable together. Will
            introduce some error however, it's better to adapt the boundary in BFF if possible.
    """

    # centroids flat is the coordinates of the center of the flattened triangles
    # scale_facs is calculated per uv triangle [num mesh elem x 1]
    centroids_uv = rs.MeshFaceCenters(uv_mesh)

    # if not using the bounding box, it will use the uv map instead.
    # the FieldSampler checks for holes or concave parts of the uv map
    # if the regular triangles are inside the mesh then True, otherwise false.
    
    inside_uv_tris = [uv_mesh.ClosestMeshPoint(rs.coerce3dpoint(rs.AddPoint(x)),0.0000000001) for x in c_grid]
    
    inside_tris = [i for i,tri in enumerate(inside_uv_tris) if tri is None]
    
    # replace all the triangles not inside by -1
    noneList(f_grid,inside_tris)
    noneList(c_grid,inside_tris)
    noneList(i_grid,inside_tris)
    noneList(x_grid,inside_tris)
    
    # get triangles with at least one vertex that's not shared by any other triangle
    idE = get_floppy_triangles(f_grid)
    
    # remove those triangles from the connectivity by -1
    idx, idxn, f_grid = removeId(f_grid, idE)
    
    # replace all the floppy tri by -1
    noneList(c_grid, idxn)
    noneList(i_grid, idxn)
    noneList(x_grid, idxn)
    
    # Actually remove all the -1, and keep the coressponding indices
    c_grid,_    = noneListR(c_grid)
    i_grid,_    = noneListR(i_grid)
    x_grid,_    = noneListR(x_grid)
    f_grid,idxD = noneListR(f_grid)
    
    # do the same for x_grid, since it is a neighbouring tri relationship
    
    temp = []
    for xi in x_grid:
        tempL = [idxD[xii] for xii in xi if xii in idxD]
        temp.append(tempL)
    x_grid = temp
    # now calculate the scale factor by averaging the scale factors of the neighbouring mesh elements in the uv mesh
    
    scale_area = []
    
    for ci in c_grid:
        index = rs.PointCloudKNeighbors(centroids_uv, ci, 5)
        d = normList([1./rs.Distance(ci, centroids_uv[i]) for i in index[0]])
        scale_area.append(sum([scale_facs[idi]*di for idi,di in zip(index[0],d)]))
        
    # get length from area change by sqrting
    scale_length   = [sqrt(x) for x in scale_area]

    if verbose == True:
        print("Min factor (uv): " + str(min(scale_length)))
        print("Max factor (uv): " + str(max(scale_length)))
        
    # now shift the scale range such that the the largest scale is the maximum 
    # (this is a heuristic, it means that the flat shape will be the smallest)
    uv_scale = scale_max / max(scale_length)
    
    scale_length = [x*uv_scale for x in scale_length]

    if verbose ==True:
        print("Scaled by " + str(uv_scale) + " to")
        print("Scaled min factor (uv): " + str(min(scale_length)))
        print("Scaled max factor (uv): " + str(max(scale_length)))
        print ('')
        
    errorTog = False
    # this only happens with expanded cells
    if max(scale_length) > scale_max*1.05:
        print("Design exceeds maximal length scaling")
        errorTog = True
    if min(scale_length) < scale_min/1.05:
        print("Design exceeds minimum length scaling")
        errorTog = True

    if geomType == 'bass':
        param_out = []     # params
        
        data = readData(dbName)
        
        id_selected = get_most_stable_for_expansion(scale_length, data, mode=mode)
        if id_selected != None:
            for idi in id_selected:
                param_out.append([data[i][idi] for i in range(0,5)])
            
    elif geomType == 'aux':
        scale_area = [(s/max(scale_length))*2 for s in scale_length]
        param_out    = [auxPhi(x) for x in scale_area]
        
    v_out     = v_grid # coordinates
    f_out     = f_grid # connectivity
    c_out     = c_grid
    i_out     = i_grid
    x_out     = x_grid
    
    v_out, f_out = remove_unused_verts(v_out, f_out)
    
    return v_out, f_out, c_out, i_out, x_out, param_out, uv_scale, scale_length, centroids_uv, errorTog
   
def auxPhi (xf):
    if xf >= 2:
        phi = 0
    elif xf <= 1:
        phi = pi/3
    else:
        phi = atan2(sqrt(3*xf - 3*sqrt(-xf**4 + 4*xf**3 - 3*xf**2))/2 , -sqrt(3*xf - 3*sqrt(-xf**4 + 4*xf**3 - 3*xf**2))*(xf**2 + 2*sqrt(-xf**4 + 4*xf**3 - 3*xf**2))*sqrt(3)/(6*xf*(xf - 2)))
    return phi
 
def scaleRange(geomType):
    if geomType =='bass':
        return [1.15,1.75]
    if geomType =='aux':
        return [1.,2.]

scaleRange = scaleRange(geomType)

if not grid_offset:
    grid_offset = [0,0,0]
    
params = {
    "modelPath":     modelPath,
    "modelName":     modelName,
    "DBpath":        DBpath,
    "scale_minimal": scaleRange[0],
    "scale_maximal": scaleRange[1],
    "grid_offset":   [grid_offset[i] for i in [0,1]],      # Manual control for centering
    "selectMode":    selectMode,    #stiffness, energy
    "geomType":      geomType
}

# The UV map (called 2D) is scaled here prior to calculating the necessary global scaling
v, f, uv, scale_facs, uv_mesh, t_mesh = load_mesh_and_scale_facs(params['modelPath'] + '/'+params['modelName']+'/'+params['modelName']+"_flat.obj", verbose=False) #0.9725

rs_v  = rs.AddPoints(v)
rs_uv = rs.AddPoints(uv)
# Generate a regular triangular grid that is centered around the flattened uv mesh
v_grid, f_grid, c_grid, i_grid, x_grid = generate_overlay_grid(rs_uv, params)

rsv_grid = rs.AddPoints(v_grid)
rsc_grid = rs.AddPoints(c_grid)

[v_out, f_out, c_out, i_out, x_out, param_out, uv_scale, scale_length,centroids_uv,errorTog] = interp_and_rescale(
        v_grid,f_grid,c_grid,x_grid, uv_mesh,
        i_grid     = i_grid,
        scale_facs = scale_facs,
        scale_min  = params["scale_minimal"],
        scale_max  = params["scale_maximal"],
        geomType   = params["geomType"],
        dbName     = params['DBpath'],
        mode       = params["selectMode"])

rsv_grid = rs.AddPoints(v_out)
rsf_grid = [rs.AddPolyline([rsv_grid[f[0]],rsv_grid[f[1]],rsv_grid[f[2]],rsv_grid[f[0]]]) for f in f_out]
rsc_grid = rs.AddPoints(c_out)

paramsModel = params.items()

uv_mesh_edge=uv_mesh.GetNakedEdges()
c_out = rs.AddPoints(c_out)
[paramsModel,param_out,v_out,f_out,x_out] = [th.list_to_tree(x) for x in [paramsModel,param_out,v_out,f_out,x_out]]

if errorTog == True:
    msg = 'Design exceeds length scaling for bistable auxetics, try using auxetics instead.'
else:
    msg = 'No errors'
# ---------- end scale_factor_calculation ----------
panel = Panel(scale_factor_calculation.msg)
number_slider_2 = Slider(0.15, range=0..1)
# Bistable auxetics (2021)
bass_generation = GhPythonScript(
    in_l_o=number_slider,
    in_s=Slider(0.125, range=0..1),
    in_c=Slider(0.15, range=0..1),
    param_out=scale_factor_calculation.param_out,
    v_out=scale_factor_calculation.v_out,
    f_out=scale_factor_calculation.f_out,
    c_out=scale_factor_calculation.c_out,
    i_out=scale_factor_calculation.i_out,
    x_out=scale_factor_calculation.x_out)  # -> out, bCrvs, cutLine, hLInner, hLBound, vList, hLInnerP, hLBoundP, vListP; inputs param_out: tree, v_out: tree, f_out: tree, c_out: list, i_out: list, x_out: tree
# ---------- bass_generation: Python ----------
import Rhino.Geometry as rg
import rhinoscriptsyntax as rs
import re
from math import sqrt, pi, tan,cos,sin,degrees
from collections import Counter

import os
import csv

import ghpythonlib.treehelpers as th
import copy

def ppClosest(h, n):
    '''
    Find the point in h that n is closest to
    '''
    tempD = [rs.Distance(hi,n) for hi in h]
    if min(tempD)>1:
        errorTog = True
    else:
        errorTog = False
    return tempD.index(min(tempD)), errorTog

def rsmP(p0,p1):
    t = rs.AddLine(p0,p1)
    return rs.CurveMidPoint(t)

def iN(n):
    if n==0:
        return 2
    elif n==1:
        return 1
    else:
        return 0
        
def mP(p0,p1):
    '''
    Find mid point of two points
    '''
    return rs.AddPoint([(p0[i]+p1[i])/2 for i in [0,1,2]])
    
def RayRayIntersection(c1,c2):
    t = rs.CurveCurveIntersection(c1,c2)
    if t == None:
        bigNum = 100
        rs.ScaleObject(c1, rs.CurveMidPoint(c1),[bigNum]*3)
        rs.ScaleObject(c2, rs.CurveMidPoint(c2),[bigNum]*3)
    
    t = rs.CurveCurveIntersection(c1,c2)[0][1]
    
    return t
    
    
def list_to_dict(a):
    it = iter(a)
    res_dct = dict(zip(it, it))
    return res_dct
    
def create_tri(l,t,s,c,theta,phi_in = 0):
    
    maximal_opening_angle = 60. + 2 * theta
    if phi_in == -1:
        phi = maximal_opening_angle
    else:
        phi = phi_in
        
    corner_left  = rs.CreatePoint([0,0,0])
    corner_right = rs.CreatePoint([l,0,0])

    ccw = 60

    line_horiz = rs.AddLine(corner_left,corner_right)
    line_left  = rs.RotateObject(line_horiz, corner_left,ccw, copy=True)
    line_right = rs.RotateObject(line_horiz, corner_right,-ccw, copy=True)

    corner_top = rs.CurveCurveIntersection(line_left,line_right)[0][1]

    vec_left_up     = rs.VectorUnitize(rs.VectorCreate(corner_top, corner_left))
    vec_bottom_left = rs.VectorUnitize(rs.VectorCreate(corner_left, corner_right))
    vec_right_down  = rs.VectorUnitize(rs.VectorCreate(corner_right, corner_top))

    pt1  = rs.CopyObject(corner_left,  vec_left_up     * t)
    pt1s = rs.CopyObject(corner_left,  vec_left_up     * (t+s))
    pt2  = rs.CopyObject(corner_right, vec_bottom_left * t)
    pt2s = rs.CopyObject(corner_right, vec_bottom_left *(t+s))
    pt3  = rs.CopyObject(corner_top,   vec_right_down  * t)
    pt3s = rs.CopyObject(corner_top,   vec_right_down  * (t+s))

    cut_lower  = rs.MoveObject(rs.RotateObject(line_horiz, corner_left, theta, copy=True), vec_left_up*t)
    cut_lower2 = rs.MoveObject(rs.RotateObject(line_horiz, corner_left, theta, copy=True), vec_left_up*(t+s))
    cut_right  = rs.MoveObject(rs.RotateObject(line_right, corner_right, theta, copy=True), vec_bottom_left*t)
    cut_right2 = rs.MoveObject(rs.RotateObject(line_right, corner_right, theta, copy=True), vec_bottom_left*(t+s))
    cut_top    = rs.MoveObject(rs.RotateObject(line_left, corner_top, theta, copy=True), vec_right_down*t)
    cut_top2   = rs.MoveObject(rs.RotateObject(line_left, corner_top, theta, copy=True), vec_right_down*(t+s))

    tri_lr = rs.CurveCurveIntersection(cut_lower2, cut_right2)[0][1]
    tri_ll = rs.CurveCurveIntersection(cut_lower2, cut_top2)[0][1]
    tri_t  = rs.CurveCurveIntersection(cut_top2, cut_right2)[0][1]

    # <--
    vec_tri_bl = rs.VectorUnitize(rs.VectorCreate(tri_ll, tri_lr))
    # /^
    vec_tri_lu = rs.VectorUnitize(rs.VectorCreate(tri_t, tri_ll))
    # \v
    vec_tri_rd = rs.VectorUnitize(rs.VectorCreate(tri_lr, tri_t))

    tri_lri = rs.CopyObject(tri_lr, vec_tri_bl * c)
    tri_lli = rs.CopyObject(tri_ll, vec_tri_lu * c)
    tri_ti  = rs.CopyObject(tri_t,  vec_tri_rd * c)

    pt1i_   = rs.CurveCurveIntersection(cut_lower, cut_right2)[0][1]
    pt1i__  = rs.CurveCurveIntersection(cut_lower, cut_right)[0][1] # used for the boundary adaption
    temp    = rs.VectorUnitize(rs.VectorCreate(pt1i_, pt1))
    pt1i    = rs.CopyObject(pt1i_, -temp*c)

    pt2i_   = rs.CurveCurveIntersection(cut_right,cut_top2)[0][1]
    pt2i__  = rs.CurveCurveIntersection(cut_right,cut_top)[0][1]
    temp    = rs.VectorUnitize(rs.VectorCreate(pt2i_, pt2))
    pt2i    = rs.CopyObject(pt2i_, -temp*c)
    #pt2i    = pt2i_ - ((pt2i_ - pt2) / (pt2i_ - pt2).norm()) * c

    pt3i_   = rs.CurveCurveIntersection(cut_top,cut_lower2)[0][1]
    pt3i__  = rs.CurveCurveIntersection(cut_top,cut_lower)[0][1]
    temp    = rs.VectorUnitize(rs.VectorCreate(pt3i_, pt3))
    pt3i    = rs.CopyObject(pt3i_, -temp*c)

    flank_lower_l = [corner_left, pt1, pt3i__, pt1i, tri_lri, tri_lr, pt1i_, pt2s,corner_left]
    flank_right_l = [corner_right, pt2, pt1i__, pt2i, tri_ti, tri_t, pt2i_, pt3s,corner_right]
    flank_top_l   = [corner_top, pt3, pt2i__, pt3i, tri_lli, tri_ll, pt3i_, pt1s,corner_top]
    triangle_l    = [tri_lli, tri_ll, tri_lri, tri_lr, tri_ti, tri_t,tri_lli]


    # move the flanks to the tips of the inner triangle
    tri_center = rs.CurveAreaCentroid(rs.AddPolyline(triangle_l))[0]
    triangle_l = rs.RotateObjects(triangle_l, tri_center, -phi, copy=True)

    flank_lower_l = rs.CopyObjects(flank_lower_l, rs.VectorCreate(triangle_l[3],flank_lower_l[5]))
    flank_right_l = rs.CopyObjects(flank_right_l, rs.VectorCreate(triangle_l[5],flank_right_l[5]))
    flank_top_l   = rs.CopyObjects(flank_top_l,   rs.VectorCreate(triangle_l[1],flank_top_l[5]))

    # inset a triangle from which to extrude the hinges
    tri_side_len      = rs.VectorLength(rs.VectorCreate(triangle_l[1], triangle_l[3]))
    tri_height        = tri_side_len * sqrt(3)/2
    target_tri_height = tri_height - (1 + 2) * c

    tri_inset_fac = target_tri_height / tri_height
    inset_tri_l   = rs.ScaleObjects(triangle_l, tri_center, [tri_inset_fac]*3, copy=True)

    #---------

    # the lines limiting the inner, inset triangle
    inset_tri_line_bottom = rs.AddLine(inset_tri_l[1], inset_tri_l[3])
    inset_tri_line_left   = rs.AddLine(inset_tri_l[1], inset_tri_l[5])
    inset_tri_line_right  = rs.AddLine(inset_tri_l[5], inset_tri_l[3])

    # lines limiting the usual inner triangle
    tri_line_bottom = rs.AddLine(triangle_l[1], triangle_l[3])
    tri_line_left   = rs.AddLine(triangle_l[1], triangle_l[5])
    tri_line_right  = rs.AddLine(triangle_l[5], triangle_l[3])

    # the lines on top of the flanks, parallel to the inner triangle lines
    flank_lower_linetop = rs.AddLine(flank_lower_l[2], flank_lower_l[3])
    flank_right_linetop = rs.AddLine(flank_right_l[2], flank_right_l[3])
    flank_top_linetop   = rs.AddLine(flank_top_l[2], flank_top_l[3])
    b=flank_lower_linetop
    
    # adapt the hinges
    flank_lower_intersect = RayRayIntersection(flank_lower_linetop, inset_tri_line_right)
    flank_lower_l[3] = flank_lower_intersect
    tri_intersect    = RayRayIntersection(tri_line_bottom, inset_tri_line_right)
    triangle_l[2]    = tri_intersect
    flank_lower_l[4] = tri_intersect

    flank_right_intersect = RayRayIntersection(flank_right_linetop, inset_tri_line_left)
    flank_right_l[3] = flank_right_intersect
    tri_intersect    = RayRayIntersection(tri_line_right,inset_tri_line_left)
    triangle_l[4]    = tri_intersect
    flank_right_l[4] = tri_intersect

    flank_top_intersect = RayRayIntersection(flank_top_linetop,inset_tri_line_bottom)
    flank_top_l[3] = flank_top_intersect
    tri_intersect  = RayRayIntersection(tri_line_left,inset_tri_line_bottom)
    triangle_l[0]  = tri_intersect
    flank_top_l[4] = tri_intersect

    # Move the triangle so it sits on 0,0 bottom left
    bl_corner = rs.CreateVector(flank_lower_l[0])

    flank_lower_l = rs.CopyObjects(flank_lower_l, -bl_corner)
    flank_right_l = rs.CopyObjects(flank_right_l, -bl_corner)
    flank_top_l   = rs.CopyObjects(flank_top_l,   -bl_corner)
    triangle_l    = rs.CopyObjects(triangle_l,    -bl_corner)

    #line_left  = rs.AddLine(flank_top_l[0], flank_top_l[-1])
    #line_right = rs.AddLine(flank_right_l[0], flank_right_l[-1])
    #line_horiz = rs.AddLine(flank_lower_l[0], flank_lower_l[-1])
    #corner_top = RayRayIntersection(line_left,line_right)

    flank_lower = rs.AddPolyline(flank_lower_l)
    flank_right = rs.AddPolyline(flank_right_l)
    flank_top   = rs.AddPolyline(flank_top_l)
    triangle    = rs.AddPolyline([triangle_l[tri_pt] for tri_pt in [1,3,5,1]])

    [x0,y0,z0]=rs.PointCoordinates(flank_right_l[-1])
    [x1,y1,z1]=rs.PointCoordinates(flank_right_l[-2])
    
    m=(y1-y0)/(x1-x0)
    b= y0-m*x0
    
    if m==0:
        print ('something is wrong with the generating tri.')
    else:
        f = b/m
        
    # Ori = rs.AddPoint([-f,0.,0.])

    #[x1,y1,z1]=rs.PointCoordinates(flank_top_l[0])
    #[x2,y2,z2]=rs.PointCoordinates(flank_top_l[-2])

    #x0=-b/m

    #y0=0
    #inscR = abs((y1-y2)*x0+(x2-x1)*y0+x1*y2-x2*y1)/sqrt((x2-x1)**2+(y2-y1)**2)
    #hexR  = inscR/cos(pi/6)

    rs.MoveObject(flank_lower,[f/2, sqrt(3)/6*f, 0])
    rs.MoveObject(flank_right,[f/2, sqrt(3)/6*f, 0])
    rs.MoveObject(flank_top,[f/2. , sqrt(3)/6*f, 0])
    rs.MoveObject(triangle,[f/2.  , sqrt(3)/6*f, 0])
    
    return [flank_lower, flank_right, flank_top, triangle, x0]

    
def genPattern(in_l_o, in_s, in_c, i_out, c_out, param_out, phi_in):

    hL = []
    vList = []
    for j,(iFlip, c, cell) in enumerate(zip(i_out, c_out, param_out)):

        # generate all the bistable triangular shapes.
        [flank_lower, flank_right, flank_top, triangle, x0] = create_tri(in_l_o,cell[0]*10.,in_s,in_c,degrees(cell[1]),phi_in)
        flanks = [flank_lower, flank_right, flank_top, triangle]
        # move them into their respective center coordinate
        [rs.MoveObject(x,c) for x in flanks]
        
        # if phi in is to open, then assume max opening
        if phi_in == -1:
            [rs.ScaleObject(x, c, [in_l_o/x0]*3) for x in flanks]
        
        # depending on whether the triangle is upright or not, flip half of them
        if iFlip == 1:
            rsc = rs.AddPoint(c)
            sP = rs.CopyObject(rsc,[-1,0,0])
            eP = rs.CopyObject(rsc,[1,0,0])

            [rs.MirrorObject(x,eP,sP) for x in flanks]
        
        # Get all the vertices
        f_p = [rs.PolylineVertices(x) for x in flanks]
        
        # Get the vertices to construct a continuous cell
        vList.append([f_p[0][0:5]+f_p[2][5:8]+f_p[2][0:5]+f_p[1][5:8]+f_p[1][0:5]+f_p[0][5:8]+f_p[0][0:1]])

        # construct the polyline for the holes
        hL.append([f_p[0][1:5]+f_p[2][5:8],f_p[1][1:5]+f_p[0][5:8],f_p[2][1:5]+f_p[1][5:8]])

    # now match up the vertices that neighbouring holes share
    hL_mod = copy.deepcopy(hL)

    iBound = []
    iInner = []
    for i,xi in enumerate(x_out):
        for j in [0,1,2]:
            for k in [0,-1]:
                temp_0 = hL[i][j][k]
                temp_1 = [hL[xii][iN(j)][k] for xii in xi]
                
                # ErrorTog is True if the point distances are too far.
                # This can only happen if they have no neighbouring holes,
                # and this happens only if the holes are at the boundary
                
                idC,errorTog = ppClosest(temp_1, temp_0)
                if errorTog == False:
                    hL_mod[i][j][k] = mP(temp_1[idC],temp_0)
                    if k==0:
                        iInner.append([i,j])
                else: # at a boundary
                    if k==0:
                        iBound.append([i,j])
                        
    # Seplit the hole polygons by whether they are interior polygons or ones that intersect with the boundary
    hLBound = []
    hLInner = []

    for iB in iBound:
        hLBound.append(rs.AddPolyline(hL_mod[iB[0]][iB[1]]))
    for iI in iInner:
        hLInner.append(rs.AddPolyline(hL_mod[iI[0]][iI[1]]))

    # This block of code finds the boundary curves.
    # iBound are the ids of the tri faces that are at the boundary
    # the boundary curves are found by finding the 1 out of 3 edges of the boundary triangle
    # that is parallel to the line that's constructed by connecting the two end points of the holes

    bCrvs = []
    for iB in iBound:
        f = f_out[iB[0]]
        c_0 = [rs.VectorCreate(v_out[f[0]],v_out[f[1]]), rs.VectorCreate(v_out[f[1]],v_out[f[2]]) ,rs.VectorCreate(v_out[f[2]],v_out[f[0]])]
        l_0 = [rs.AddLine(v_out[f[0]],v_out[f[1]]), rs.AddLine(v_out[f[1]],v_out[f[2]]) ,rs.AddLine(v_out[f[2]],v_out[f[0]])]

        t_1 = hL[iB[0]][iB[1]]
        v_1 = rs.VectorCreate(t_1[-1],t_1[0])
        p_1 = [rs.IsVectorParallelTo(v_1,ti) for ti in c_0]
        
        for i,ti in enumerate(p_1):
            if ti!=0: # if not 0, then either parallel or antiparallel
                if ti == -1:
                    rs.ReverseCurve(l_0[i])
                bCrvs.append(l_0[i])

    # This block of code converts the hole polylines into hole lines by finding the mid point
    cutLine = []
    for hL in hL_mod:
        mL = []
        for hLi in hL:
            mL.append(rs.AddPolyline([rsmP(hLi[0],hLi[6]),rsmP(hLi[1],hLi[5]),rsmP(hLi[2],hLi[3])]))
        cutLine.append(mL)
        
    cutLine = th.list_to_tree(cutLine)
    vList = th.list_to_tree(vList)
    bCrvs = rs.JoinCurves(bCrvs)
    return [bCrvs, cutLine, hLInner, hLBound,vList]

[param_out,v_out,f_out,x_out] = [th.tree_to_list(x) for x in [param_out,v_out,f_out,x_out]]

# param out format 
#ts          = param_out[0]
#thetas      = param_out[1]
#expansions  = param_out[2]
#energies    = param_out[3]
#stiffnesses = param_out[4]

param_out_t = map(list, zip(*param_out)) # Transpose param list of list
ts         = param_out_t[0]
thetas     = param_out_t[1]
expansions = param_out_t[2]

# Create trimmed grid mesh
grid_mesh = rg.Mesh()

for vi in v_out:
    grid_mesh.Vertices.Add(rg.Point3d(*vi))
for fi in f_out:
    grid_mesh.Faces.AddFace(rg.MeshFace(*fi))

rsv_grid = rs.AddPoints(v_out)
rsc_grid = rs.AddPoints(c_out)
rsf_grid = [rs.AddPolyline([v_out[f[0]],v_out[f[1]],v_out[f[2]],v_out[f[0]]]) for f in f_out]

[bCrvs, cutLine, hLInner, hLBound,vList] = genPattern(in_l_o, in_s, in_c, i_out, c_out, param_out, 0)

[bCrvsP, cutLineP, hLInnerP, hLBoundP,vListP] = genPattern(in_l_o, in_s, in_c, i_out, c_out, param_out, -1)
# ---------- end bass_generation ----------
# Deployable auxetics (2018)
auxetic_generation = GhPythonScript(
    in_l_o=number_slider,
    in_s=Slider(0.025, range=0..1),
    in_c=number_slider_2,
    i_out=scale_factor_calculation.i_out,
    c_out=scale_factor_calculation.c_out,
    x_out=scale_factor_calculation.x_out,
    phiList=scale_factor_calculation.param_out)  # -> hLInner, hLInnerF, bPts; inputs i_out: list, c_out: list, x_out: tree, phiList: list
# ---------- auxetic_generation: Python ----------
import Rhino.Geometry as rg
import re
from math import sqrt, pi, tan,cos,sin,degrees, atan, atan2
import rhinoscriptsyntax as rs
from collections import Counter

import os
import csv

import ghpythonlib.treehelpers as th
import copy

import rhinoscriptsyntax as rs

def norm(a):
    return sqrt(sum([a[i]**2 for i in [0,1,2]]))
     
def vecMult(v,a):
    return [vi*a for vi in v]
    
def ppClosest(h, n):
    '''
    Find the point in h that n is closest to
    '''
    tempD = [rs.Distance(hi,n) for hi in h]
    if min(tempD)>2:
        errorTog = True
    else:
        errorTog = False
    return tempD.index(min(tempD)), errorTog


def mP(p0,p1):
    '''
    Find mid point of two points
    '''
    return rs.AddPoint([(p0[i]+p1[i])/2 for i in [0,1,2]])
    

def iN(j,k,in_c,in_s):
    if in_c!=0 and in_s!=0:
        if k == 0:
            if j == 0:
                return 1
            if j == 1:
                return 0
            if j == 2:
                return 2
        if k == -1:
            if j == 0:
                return 2
            if j == 1:
                return 1
            if j == 2:
                return 0
    else:
        if k == 0:
            if j == 0:
                return 2
            if j == 1:
                return 1
            if j == 2:
                return 0
        if k == -1:
            if j == 0:
                return 0
            if j == 1:
                return 2
            if j == 2:
                return 1

x_out = th.tree_to_list(x_out)

# calculating the regular triangle
rTri  = []
rTri.append([-sqrt(3)/2*in_l_o+sqrt(3)/6*in_l_o*2, -in_l_o/2])
rTri.append([-sqrt(3)/2*in_l_o+sqrt(3)/6*in_l_o*2, in_l_o/2])
rTri.append([sqrt(3)/6*in_l_o*2, 0.])
rTri  = rs.AddPoints(rTri)
rTri.append(rTri[0])
regPL = rs.AddPolyline(rTri)


def genTri(i_out,c_out,x_out, phiList, in_l_o, in_s, in_c):
 
    conLineT = []
    
    # generate a triangle given the phi value. The phi value is determined by the scale factor
    
    for j, (iFlip, c, phi) in enumerate(zip(i_out, c_out, phiList)):
        
        y1 = sin(phi)/sin(pi/3)

        x2 = cos(pi/6-phi)
        y2 = y1+sin(pi/6-phi)

        x3 = sin(phi)
        y3 = y1+cos(phi)

        ptL = []
        ptL.append([0, y1,0])
        ptL.append([x2,y2,0])
        ptL.append([x3,y3,0])
        ptL.append([0, y1,0])
        rsPtL = rs.AddPoints(ptL)

        theta = (atan(ptL[2][0]/ ptL[2][1]))
        
        # rescale the triangle to fit the boundary of the grid trig
        sizing_factor = (sqrt(3)/((tan(theta) + sqrt(3))*cos(theta)))/norm(ptL[2])

        # and also scale by the l_o
        rs.ScaleObjects(rsPtL,[0,0,0],[in_l_o*sizing_factor]*3)
        
        # move the triangle to center at 0,0,0
        rs.MoveObjects(rsPtL, [-in_l_o*0.5/tan(pi/3),-in_l_o*0.5,0])
    
        rsPtL.append(rsPtL[0])
        
        actPL  = rs.AddPolyline(rsPtL)
        if in_s!=0. and in_c!=0.:
            
            # if the 
            cL = [rs.ScaleObject(rs.AddLine([0,0,0],x), [0,0,0], [5]*3) for x in rsPtL]
            
            cV = [rs.VectorUnitize(rs.VectorCreate([0,0,0], x)) for x in rsPtL]

            cV = [rs.VectorRotate(x, -90, [0,0,1]) for x in cV]

            c0=[rs.CopyObject(x,vecMult(y, -in_c)) for x,y in zip(cL,cV)]
            c1=[rs.CopyObject(x,vecMult(y, in_c)) for x,y in zip(cL,cV)]

         
            actPLo = rs.OffsetCurve(actPL, [0,0,0], in_s)
            
            conLine = []
            triLine = []
            triLineT = []
            
            inP  = []
            outP = []
            for i in [0,1,2]:
                outP.append(rs.CurveCurveIntersection(c0[i], regPL )[0][1])
                inP.append(rs.CurveCurveIntersection( c0[i], actPLo)[0][1])
                conLine.append(rs.AddLine(outP[-1],inP[-1]))
                outP.append(rs.CurveCurveIntersection(c1[i], regPL )[0][1])
                inP.append(rs.CurveCurveIntersection( c1[i], actPLo)[0][1])
                conLine.append(rs.AddLine(outP[-1],inP[-1]))

            triLine = [rs.AddLine(inP[i-1],inP[i]) for i in range(0,5,2)]
            
            [rs.RotateObjects(x, [0,0,0],-30) for x in conLine]
            [rs.RotateObjects(x, [0,0,0],-30) for x in triLine]
            
            # move them into their respective center coordinate
            [rs.MoveObject(x,c) for x in conLine]
            [rs.MoveObject(x,c) for x in triLine]
            
            # depending on whether the triangle is upright or not, flip half of them
            if iFlip==1:
                sP = rs.CopyObject(c,[-1,0,0])
                eP = rs.CopyObject(c,[1,0,0])
                
                [rs.MirrorObject(x,eP,sP) for x in conLine]
                [rs.MirrorObject(x,eP,sP) for x in triLine]
            
            triLineT.append(rs.JoinCurves([conLine[5], triLine[0], conLine[0]]))
            triLineT.append(rs.JoinCurves([conLine[1], triLine[1], conLine[2]]))
            triLineT.append(rs.JoinCurves([conLine[3], triLine[2], conLine[4]]))
            
            conLineT.append(triLineT)
        else:
            rs.RotateObjects(actPL, [0,0,0],-30)
            # move them into their respective center coordinate
            rs.MoveObject(actPL,c)
            
            # depending on whether the triangle is upright or not, flip half of them
            if iFlip==1:
                sP = rs.CopyObject(c,[-1,0,0])
                eP = rs.CopyObject(c,[1,0,0])
                rs.MirrorObject(actPL,eP,sP)
            
            conLineT.append(rs.ExplodeCurves(actPL))
        
    conPtT = []
    for x in conLineT:
        conPtT.append([rs.PolylineVertices(y) for y in x])

    # now match up the vertices that neighbouring holes share
    conPtT_mod = copy.deepcopy(conPtT)
    bPts = []
    iInnerT = []

    for i,xi in enumerate(x_out):
        iInner = []
        for j in [0,1,2]:
            for k in [0,-1]:
                temp_0 = conPtT[i][j][k]
                temp_1 = [conPtT[xii][iN(j,k,in_c,in_s)][k] for xii in xi]
                
                # ErrorTog is True if the point distances are too far.
                # This can only happen if they have no neighbouring holes,
                # and this happens only if the holes are at the boundary
                
                idC,errorTog = ppClosest(temp_1, temp_0)
                if errorTog == False:
                    conPtT_mod[i][j][k] = mP(temp_1[idC],temp_0)
                else:
                    bPts.append(conPtT[i][j][k])
            iInner.append([i,j])
        iInnerT.append(iInner)
        
    # Split the hole polygons by whether they are interior polygons or ones that intersect with the boundary

    hLInnerT = []
    
    for iInner in iInnerT:
        hLInner = []
        for iI in iInner:
            temp = conPtT_mod[iI[0]][iI[1]]
            hLInner.append(rs.AddPolyline(temp))
        hLInnerT.append(rs.JoinCurves(hLInner))
        
    hLInnerT = th.list_to_tree(hLInnerT)
    return [hLInnerT, bPts] 
    
# generate two sets of triangles, the first is in the closed and flat state
[hLInner, bPts]   = genTri(i_out,c_out,x_out, phiList, in_l_o, in_s, in_c)
# generate two sets of triangles, the first is in the closed and flat state
[hLInnerF, bPtsF]  = genTri(i_out,c_out,x_out, phiList, in_l_o, 0., 0.)
# ---------- end auxetic_generation ----------
aux_gen_fully_open = GhPythonScript(
    in_l_o=number_slider,
    i_out=scale_factor_calculation.i_out,
    c_out=scale_factor_calculation.c_out,
    x_out=scale_factor_calculation.x_out,
    phiList=scale_factor_calculation.param_out)  # -> hLInnerF; inputs i_out: list, c_out: list, x_out: tree, phiList: list
# ---------- aux_gen_fully_open: Python ----------
import Rhino.Geometry as rg
import re
from math import sqrt, pi, tan,cos,sin,degrees, atan, atan2
import rhinoscriptsyntax as rs
from collections import Counter

import os
import csv

import ghpythonlib.treehelpers as th
import copy

import rhinoscriptsyntax as rs

def norm(a):
    return sqrt(sum([a[i]**2 for i in [0,1,2]]))
     
def vecMult(v,a):
    return [vi*a for vi in v]
    
def ppClosest(h, n):
    '''
    Find the point in h that n is closest to
    '''
    tempD = [rs.Distance(hi,n) for hi in h]
    if min(tempD)>2:
        errorTog = True
    else:
        errorTog = False
    return tempD.index(min(tempD)), errorTog


def mP(p0,p1):
    '''
    Find mid point of two points
    '''
    return rs.AddPoint([(p0[i]+p1[i])/2 for i in [0,1,2]])
    

def iN(j,k,in_c,in_s):
    if in_c!=0 and in_s!=0:
        if k == 0:
            if j == 0:
                return 1
            if j == 1:
                return 0
            if j == 2:
                return 2
        if k == -1:
            if j == 0:
                return 2
            if j == 1:
                return 1
            if j == 2:
                return 0
    else:
        if k == 0:
            if j == 0:
                return 2
            if j == 1:
                return 1
            if j == 2:
                return 0
        if k == -1:
            if j == 0:
                return 0
            if j == 1:
                return 2
            if j == 2:
                return 1

x_out = th.tree_to_list(x_out)

# calculating the regular triangle
rTri  = []
rTri.append([-sqrt(3)/2*in_l_o+sqrt(3)/6*in_l_o*2, -in_l_o/2])
rTri.append([-sqrt(3)/2*in_l_o+sqrt(3)/6*in_l_o*2, in_l_o/2])
rTri.append([sqrt(3)/6*in_l_o*2, 0.])
rTri  = rs.AddPoints(rTri)
rTri.append(rTri[0])
regPL = rs.AddPolyline(rTri)


def genTri(i_out,c_out,x_out, phiList, in_l_o, in_s, in_c):
 
    conLineT = []
    
    # generate a triangle given the phi value. The phi value is determined by the scale factor
    
    for j, (iFlip, c, phi) in enumerate(zip(i_out, c_out, phiList)):
        
        y1 = sin(phi)/sin(pi/3)

        x2 = cos(pi/6-phi)
        y2 = y1+sin(pi/6-phi)

        x3 = sin(phi)
        y3 = y1+cos(phi)

        ptL = []
        ptL.append([0, y1,0])
        ptL.append([x2,y2,0])
        ptL.append([x3,y3,0])
        ptL.append([0, y1,0])
        rsPtL = rs.AddPoints(ptL)

        theta = (atan(ptL[2][0]/ ptL[2][1]))
        
        # rescale the triangle to fit the boundary of the grid trig
        sizing_factor = (sqrt(3)/((tan(theta) + sqrt(3))*cos(theta)))/norm(ptL[2])

        # and also scale by the l_o
        rs.ScaleObjects(rsPtL,[0,0,0],[in_l_o*sizing_factor]*3)
        
        # move the triangle to center at 0,0,0
        rs.MoveObjects(rsPtL, [-in_l_o*0.5/tan(pi/3),-in_l_o*0.5,0])
    
        rsPtL.append(rsPtL[0])
        
        actPL  = rs.AddPolyline(rsPtL)

        rs.RotateObjects(actPL, [0,0,0],-30)
        # move them into their respective center coordinate
        rs.MoveObject(actPL,c)
        
        # depending on whether the triangle is upright or not, flip half of them
        if iFlip==1:
            sP = rs.CopyObject(c,[-1,0,0])
            eP = rs.CopyObject(c,[1,0,0])
            rs.MirrorObject(actPL,eP,sP)
        
        conLineT.append(rs.ExplodeCurves(actPL))
        
    conPtT = []
    for x in conLineT:
        conPtT.append([rs.PolylineVertices(y) for y in x])

    # now match up the vertices that neighbouring holes share
    conPtT_mod = copy.deepcopy(conPtT)
    bPts = []
    iInnerT = []

    for i,xi in enumerate(x_out):
        iInner = []
        for j in [0,1,2]:
            for k in [0,-1]:
                temp_0 = conPtT[i][j][k]
                temp_1 = [conPtT[xii][iN(j,k,in_c,in_s)][k] for xii in xi]
                
                # ErrorTog is True if the point distances are too far.
                # This can only happen if they have no neighbouring holes,
                # and this happens only if the holes are at the boundary
                
                idC,errorTog = ppClosest(temp_1, temp_0)
                if errorTog == False:
                    conPtT_mod[i][j][k] = mP(temp_1[idC],temp_0)
                else:
                    bPts.append(conPtT[i][j][k])
            iInner.append([i,j])
        iInnerT.append(iInner)
        
    # Split the hole polygons by whether they are interior polygons or ones that intersect with the boundary

    hLInnerT = []
    
    for iInner in iInnerT:
        hLInner = []
        for iI in iInner:
            temp = conPtT_mod[iI[0]][iI[1]]
            hLInner.append(rs.AddPolyline(temp))
        hLInnerT.append(rs.JoinCurves(hLInner))
        
    hLInnerT = th.list_to_tree(hLInnerT)
    return [hLInnerT, bPts] 

# the second, is the opened, and will be lifted into the 3D state
phiFull = [pi/3 for x in phiList]
[hLInnerF, bPtsF]  = genTri(i_out,c_out,x_out, phiFull, in_l_o, 0., 0.)
# ---------- end aux_gen_fully_open ----------
merge = Merge(Data1=bass_generation.bCrvs, Data2=bass_generation.hLInner, Data3=bass_generation.hLBound)
merge_2 = Merge(Data1=bass_generation.bCrvs, Data2=bass_generation.hLInnerP, Data3=bass_generation.hLBoundP)
cp = GhPythonScript(uv_c=scale_factor_calculation.centroids_uv, Ls=flatten(auxetic_generation.hLInnerF))  # -> idxT; inputs uv_c: list, Ls: list
# ---------- cp: Python ----------
import ghpythonlib.treehelpers as th
import rhinoscriptsyntax as rs

if Ls[0] != None:
    idxT = []
    for i,tri in enumerate(Ls):
        temp = rs.PolylineVertices(tri)
        idxT.append([rs.PointArrayClosestPoint(uv_c, tri_p) for tri_p in temp])

idxT = th.list_to_tree(idxT)
# ---------- end cp ----------
alongcrv = SortAlongCurve(Points=auxetic_generation.bPts, Curve=scale_factor_calculation.uv_mesh_edge)  # -> Points, Indices
cp_2 = GhPythonScript(uv_c=scale_factor_calculation.centroids_uv, Ls=merge)  # -> idxT; inputs uv_c: list, Ls: list; same code as cp
python_2 = GhPythonScript(V=alongcrv.Points, cg=number_slider_2)  # -> SOut; inputs V: list
# ---------- python_2: Python ----------
import rhinoscriptsyntax as rs

PL = rs.AddPolyline(V)
S = rs.ExplodeCurves(PL)
SOut = []
for Si in S:
    if rs.CurveLength(Si)<cg*10.:
        SOut.append(Si)
# ---------- end python_2 ----------

# ----
# Outlines
crv = Curve([bass_generation.hLInner, bass_generation.bCrvs])

# ----
# Cart —> barycentric
cart_bary = GhPythonScript(
    uv_mesh=scale_factor_calculation.uv_mesh,
    t_mesh=scale_factor_calculation.t_mesh,
    idxT=cp,
    Ls=flatten(aux_gen_fully_open))  # -> t_bc_coord, bc_coord; inputs idxT: tree, Ls: list
# ---------- cart_bary: Python ----------
import ghpythonlib.treehelpers as th
import rhinoscriptsyntax as rs

def BCentric (tri,p):
    v0 = rs.VectorCreate(tri[1],tri[0])
    v1 = rs.VectorCreate(tri[2],tri[0])
    v2 = rs.VectorCreate(p,     tri[0])

    d00 = rs.VectorDotProduct(v0,v0)
    d01 = rs.VectorDotProduct(v0,v1)
    d11 = rs.VectorDotProduct(v1,v1)
    d20 = rs.VectorDotProduct(v2,v0)
    d21 = rs.VectorDotProduct(v2,v1)

    denom = d00 * d11 - d01 * d01

    v = (d11 * d20 - d01 * d21) / denom
    w = (d00 * d21 - d01 * d20) / denom

    u = 1.0 - v - w

    return [u, v, w]
   
idxT = th.tree_to_list(idxT)
 
uv_f = rs.MeshFaceVertices(uv_mesh)
uv_coord = []
uv_pl = []
uv_p = rs.MeshVertices(uv_mesh)
t_coord = []
t_f  = rs.MeshFaceVertices(t_mesh)
t_p = rs.MeshVertices(t_mesh)

for t_fi in t_f:
    temp = list(t_fi)[0:3]
    t_coord.append([t_p[x] for x in temp])
    uv_coord.append([uv_p[x] for x in temp])
    
bc_coord = []
t_bc_coord = []

if Ls[0] != None:
    pList = []
    for i,tri in enumerate(Ls):
        temp = rs.PolylineVertices(tri)
        pList.append(temp)
        for j, tri_p in enumerate(temp):
            id = idxT[i][j]
            bc_coord.append(BCentric(uv_coord[id],tri_p))
            t_bc_coord.append(t_coord[id])

    pList = th.list_to_tree(pList)
    bc_coord = th.list_to_tree(bc_coord)
    t_bc_coord = th.list_to_tree(t_bc_coord)
# ---------- end cart_bary ----------
# Cart —> barycentric
cart_bary_2 = GhPythonScript(uv_mesh=scale_factor_calculation.uv_mesh, t_mesh=scale_factor_calculation.t_mesh, idxT=cp_2, Ls=merge_2)  # -> t_bc_coord, bc_coord, lLen; inputs idxT: tree of Int32, Ls: list
# ---------- cart_bary_2: Python ----------
import ghpythonlib.treehelpers as th
import rhinoscriptsyntax as rs

def BCentric (tri,p):
    v0 = rs.VectorCreate(tri[1],tri[0])
    v1 = rs.VectorCreate(tri[2],tri[0])
    v2 = rs.VectorCreate(p,     tri[0])

    d00 = rs.VectorDotProduct(v0,v0)
    d01 = rs.VectorDotProduct(v0,v1)
    d11 = rs.VectorDotProduct(v1,v1)
    d20 = rs.VectorDotProduct(v2,v0)
    d21 = rs.VectorDotProduct(v2,v1)

    denom = d00 * d11 - d01 * d01

    v = (d11 * d20 - d01 * d21) / denom
    w = (d00 * d21 - d01 * d20) / denom

    u = 1.0 - v - w

    return [u, v, w]
   
idxT = th.tree_to_list(idxT)
 
uv_f = rs.MeshFaceVertices(uv_mesh)
uv_coord = []
uv_pl = []
uv_p = rs.MeshVertices(uv_mesh)
t_coord = []
t_f  = rs.MeshFaceVertices(t_mesh)
t_p = rs.MeshVertices(t_mesh)

for t_fi in t_f:
    temp = list(t_fi)[0:3]
    t_coord.append([t_p[x] for x in temp])
    uv_coord.append([uv_p[x] for x in temp])
    
bc_coord = []
t_bc_coord = []

lLen = []
if Ls[0] != None:
    pList = []
    for i,tri in enumerate(Ls):
        temp = rs.PolylineVertices(tri)
        lLen.append(len(temp))
        pList.append(temp)
        for j, tri_p in enumerate(temp):
            id = idxT[i][j]
            bc_coord.append(BCentric(uv_coord[id],tri_p))
            t_bc_coord.append(t_coord[id])

    pList = th.list_to_tree(pList)
    bc_coord = th.list_to_tree(bc_coord)
    t_bc_coord = th.list_to_tree(t_bc_coord)
# ---------- end cart_bary_2 ----------
join = JoinCurves(Curves=flatten([python_2, auxetic_generation.hLInner]), Preserve=False)
area = Area(Geometry=scale_factor_calculation.uv_mesh_edge)  # -> Area, Centroid
relay = Relay([bass_generation.cutLine, bass_generation.bCrvs])
item = ListItem(List=cart_bary_2.t_bc_coord, Index=0, Wrap=True)  # -> Item, Item1, Item2
item_2 = ListItem(List=cart_bary_2.bc_coord, Index=0, Wrap=True)  # -> Item, Item1, Item2
item_3 = ListItem(List=cart_bary.t_bc_coord, Index=0, Wrap=True)  # -> Item, Item1, Item2
item_4 = ListItem(List=cart_bary.bc_coord, Index=0, Wrap=True)  # -> Item, Item1, Item2
# Barycentric —> Cart
bcentric = Barycentric(
    PointA=item.Item,
    PointB=item.Item1,
    PointC=item.Item2,
    CoordinateU=item_2.Item,
    CoordinateV=item_2.Item1,
    CoordinateW=item_2.Item2)  # -> flatten(Point)

# ----
# deployment control
number_slider_3 = Slider(1, range=0..1)

# ----
# Barycentric —> Cart
bary_cart = Barycentric(
    PointA=item_3.Item,
    PointB=item_3.Item1,
    PointC=item_3.Item2,
    CoordinateU=item_4.Item,
    CoordinateV=item_4.Item1,
    CoordinateW=item_4.Item2)

# ----
# deployment control
number_slider_4 = Slider(1, range=0..1)

partition = PartitionList(List=bcentric, Size=cart_bary_2.lLen)
pline = PolyLine(Vertices=partition, Closed=False)  # -> flatten(Polyline)
swatch = ColourSwatch(SwatchColor=RGB(152, 217, 143))
deployment = GhPythonScript(
    modelName=list,
    PT3D=bary_cart,
    PT2D=auxetic_generation.hLInnerF,
    T=area.Centroid,
    c=Slider(4, range=0..10),
    p=number_slider_4)  # -> triPoly; inputs PT3D: tree, PT2D: tree, T: list of Vector3d, c: Int32
# ---------- deployment: Python ----------
import ghpythonlib.treehelpers as th
import rhinoscriptsyntax as rs
T=T[0]
PT3D = th.tree_to_list(PT3D)

PT2D = th.tree_to_list(PT2D)

rs.MoveObjects(PT2D, -T)

if modelName=='double_dome':
    rs.RotateObjects(PT2D, [0,0,0], 180, [1,0,0])
    rs.RotateObjects(PT3D, [0,0,0], -90, [1,0,0])
    rs.RotateObjects(PT3D, [0,0,0], 180, [1,0,0])
elif modelName=='hypar':
    rs.RotateObjects(PT2D, [0,0,0], 180, [1,0,0])
    rs.RotateObjects(PT2D, [0,0,0], 180, [0,1,0])
    rs.RotateObjects(PT3D, [0,0,0], 90, [1,0,0])
elif modelName=='hemisphere':
    rs.RotateObjects(PT3D, [0,0,0], 90, [1,0,0])
elif modelName=='lilium_tower':
    rs.RotateObjects(PT3D, [0,0,0], 90, [1,0,0])
    rs.RotateObjects(PT2D, [0,0,0], 45, [0,0,1])
elif modelName=='quarter_dome':
    rs.RotateObjects(PT2D, [0,0,0], 180, [1,0,0])
    rs.RotateObjects(PT2D, [0,0,0], 180, [0,1,0])
    rs.RotateObjects(PT2D, [0,0,0], -35, [0,0,1])
    rs.RotateObjects(PT3D, [0,0,0], 90, [1,0,0])
elif modelName=='squidward':
    rs.RotateObjects(PT3D, [0,0,0], 90, [1,0,0])
elif modelName=='tigridia':
    rs.RotateObjects(PT2D, [0,0,0], -30, [0,0,1])
elif modelName=='heart':
    rs.RotateObjects(PT2D, [0,0,0], 90, [1,0,0])
    rs.RotateObjects(PT2D, [0,0,0], 90, [0,1,0])
    rs.RotateObjects(PT3D, [0,0,0], 90, [1,0,0])
else:
    rs.RotateObjects(PT2D, [0,0,0], 90, [1,0,0])
PT2D = [rs.PolylineVertices(x) for x in PT2D]

def chunks(lst, n):
    nlst = []
    """Yield successive n-sized chunks from lst."""
    for i in range(0, len(lst), n):
        nlst.append(lst[i:i + n])
    nlst = [[inner[0] for inner in sublst] for sublst in nlst]
    return nlst
PT3D = chunks(PT3D,c)

pts = []
for P2, P3 in zip(PT2D,PT3D):
    l = [rs.AddLine(P2i, P3i) for P2i, P3i in zip(P2,P3)]
    lengths = [rs.CurveLength(li) for li in l]
    pts.append([rs.EvaluateCurve(li,length*p) for li,length in zip(l,lengths)])
    
triPoly = [rs.AddPolyline(pt) for pt in pts]
# ---------- end deployment ----------
deployment_2 = GhPythonScript(modelName=list, PT3D=pline, PT2D=merge, T=area.Centroid, c=cart_bary_2.lLen, p=number_slider_3)  # -> bCrv, pts; inputs PT3D: list, PT2D: list, T: list of Vector3d, c: list of Int32
# ---------- deployment_2: Python ----------
import ghpythonlib.treehelpers as th
import rhinoscriptsyntax as rs
T=T[0]

rs.MoveObjects(PT2D, -T)

if modelName=='double_dome':
    rs.RotateObjects(PT2D, [0,0,0], 180, [1,0,0])
    rs.RotateObjects(PT3D, [0,0,0], -90, [1,0,0])
    rs.RotateObjects(PT3D, [0,0,0], 180, [1,0,0])
elif modelName=='hypar':
    rs.RotateObjects(PT2D, [0,0,0], 180, [1,0,0])
    rs.RotateObjects(PT2D, [0,0,0], 180, [0,1,0])
    rs.RotateObjects(PT3D, [0,0,0], 90, [1,0,0])
elif modelName=='hemisphere':
    rs.RotateObjects(PT3D, [0,0,0], 90, [1,0,0])
elif modelName=='lilium_tower':
    rs.RotateObjects(PT3D, [0,0,0], 90, [1,0,0])
    rs.RotateObjects(PT2D, [0,0,0], 45, [0,0,1])
elif modelName=='quarter_dome':
    rs.RotateObjects(PT2D, [0,0,0], 180, [1,0,0])
    rs.RotateObjects(PT2D, [0,0,0], 180, [0,1,0])
    rs.RotateObjects(PT2D, [0,0,0], -35, [0,0,1])
    rs.RotateObjects(PT3D, [0,0,0], 90, [1,0,0])
elif modelName=='squidward':
    rs.RotateObjects(PT3D, [0,0,0], 90, [1,0,0])
elif modelName=='tigridia':
    rs.RotateObjects(PT2D, [0,0,0], -30, [0,0,1])
elif modelName=='heart':
    rs.RotateObjects(PT2D, [0,0,0], 90, [1,0,0])
    rs.RotateObjects(PT2D, [0,0,0], 90, [0,1,0])
    rs.RotateObjects(PT3D, [0,0,0], 90, [1,0,0])
    
pts = []

for P2, P3 in zip(PT2D,PT3D):
    P2P = rs.PolylineVertices(P2)
    P3P = rs.PolylineVertices(P3)
    l = [rs.AddLine(P2i, P3i) for P2i, P3i in zip(P2P,P3P)]
    lengths = [rs.CurveLength(li) for li in l]
    pts.append([rs.EvaluateCurve(li,length*p) for li,length in zip(l,lengths)])
    
bCrv = rs.AddPolyline(pts[0])

pts = th.list_to_tree(pts[1:])
# ---------- end deployment_2 ----------
material = CreateMaterial(Diffuse=swatch, Specular=swatch, Emission=swatch, Transparency=0, Shine=0)
pline_2 = PolyLine(Vertices=deployment_2.pts, Closed=False)  # -> flatten(Polyline)
crv_2 = Curve(deployment_2.bCrv)

# ----
# deployed geometry
preview = CustomPreview(Geometry=[pline_2, crv_2], Material=material)

preview_2 = CustomPreview(
    Geometry=pline_2,
    Material={diffuse=RGB(221, 160, 221), emission=RGB(66, 48, 66), shine=0.5, specular=RGB(255, 255, 255), transparency=0})

# ----
# Cut Pattern
crv_3 = Curve(relay)

# ----
# Shape generation
# Cut lines
crv_4 = Curve(join)

# ----
# deployed geometry
srf = Surface(deployment)
