# Grasshopper definition polyhedron-shaper.gh (Grasshopper 1.0.7)
# plug-ins: GhPolyhedra

# ----
# Base Form Parameter
base_form = ValueList({"biscribed truncated cuboctahedron", "cuboctahedron", "biscribed truncated octahedron", "biscribed truncated icosidodecahedron", "chamfered cube", "chamfered dodecahedron", "chamfered icosahedron", "chamfered octahedron", "canonical joined truncated icosahedron", "deltoidal hexecontahedron", "dual geodesic icosahedron pattern 1", "dual geodesic icosahedron pattern 2", "dual geodesic icosahedron pattern 3", "dual geodesic icosahedron pattern 4", "dual geodesic icosahedron pattern 5", "dual geodesic icosahedron pattern 6", "dual geodesic icosahedron pattern 7", "dual geodesic icosahedron pattern 8", "dual geodesic icosahedron pattern 9", "dual geodesic icosahedron pattern 10", "dual geodesic icosahedron pattern 11", "dual geodesic icosahedron pattern 12", "dual geodesic icosahedron pattern 13", "dual geodesic icosahedron pattern 14", "dual geodesic icosahedron pattern 15", "dual geodesic icosahedron pattern 16", "dual geodesic icosahedron pattern 17", "dual geodesic icosahedron pattern 18", "dual geodesic icosahedron pattern 19", "dual geodesic icosahedron pattern 20"}, selected="chamfered dodecahedron")
overall_size = Slider(2.8, range=0..10)

# ----
# Individual Unit Parameter
unit_middle_section_height = Slider(1.28, range=1..3)
unit_middle_section_size = Slider(0.74, range=0..2)
unit_tip_height = Slider(0.86, range=0..3)
# This definition is created by Sim Pern Chong.
# https://app.box.com/s/oei5daidbvr0gulsksbw59st73n6m5le
# 
# This definition requires Rhino Polyhedra plugin
# 
# Usage Instruction is at
# https://youtu.be/uPYf5Eoxi1g
# Disclaimer: The GH file attempts to be as accurate as possible.
# However, the Author does not warrant that the script is entirely accurate,
# complete, reliable, current or error-free.
# You assume full responsibility for its usage.
# The Author cannot be held liable in any way for results stemming from the practical
# use of this information. Under no circumstances shall the Author be liable for
# damages of any kind arising from the use of this script,
# including, but not limited to, direct, indirect, special, consequential or punitive
# damages or lost profits.
unit_tip_size = Slider(0.21, range=0..2)

polyhedron = Polyhedron(Name=base_form, Plane=PlaneXY(0, 0, 0), Scale=overall_size)  # -> Curves, Meshes, Solid
face_boundaries = FaceBoundaries(Mesh=polyhedron.Meshes)

area = Area(Geometry=polyhedron.Meshes)  # -> Area, Centroid
scale = Scale(Geometry=polyhedron.Meshes, Center=area.Centroid, Factor=unit_middle_section_size)  # -> Geometry, Transform
scale_2 = Scale(Geometry=scale.Geometry, Center=Point(0, 0, 0), Factor=unit_middle_section_height)  # -> Geometry, Transform
face_boundaries_2 = FaceBoundaries(Mesh=scale_2.Geometry)

scale_3 = Scale(Geometry=scale_2.Geometry, Center=Point(0, 0, 0), Factor=unit_tip_height)  # -> Geometry, Transform
area_2 = Area(Geometry=scale_3.Geometry)  # -> Area, Centroid
scale_4 = Scale(Geometry=scale_3.Geometry, Center=area_2.Centroid, Factor=unit_tip_size)  # -> Geometry, Transform
face_boundaries_3 = FaceBoundaries(Mesh=scale_4.Geometry)

boundary_surfaces = BoundarySurfaces(Edges=face_boundaries_3)
loft = Loft(
    Curves=[face_boundaries, face_boundaries_2, face_boundaries_3],
    Options={Adjust=False, Closed=False, LoftEnds=0, LoftSimp=0, LoftType=0, Rebuild=10, Refit=0.01})
custom_preview = CustomPreview(
    Geometry=[loft, boundary_surfaces],
    Material={diffuse=RGB(221, 160, 221), emission=RGB(66, 48, 66), shine=0.5, specular=RGB(255, 255, 255), transparency=0})
